# Grasshopper definition performance stage design.gh (Grasshopper 0.9.76)

分段 = Slider(25, range=0..100)
钢架密度 = Slider(20, range=0..100)
范围半径 = Slider(56, range=0..100)
cir = Circle(Plane="{0,0,0}", Radius=范围半径)
pframes = PerpFrames(Curve=cir, Count=分段, Align=True)  # -> Frames, Parameters
ellipse = Ellipse(Plane=pframes.Frames, Radius1=Slider(33.97, range=0..100), Radius2=1)  # -> Ellipse, Focus1, Focus2
crv = Curve(ellipse.Ellipse)
lng = ListLength(List=crv)
range = Range(Domain="0 to 360", Steps=lng)
pln = Plane(pframes.Frames)
shift = ShiftList(List=range, Shift=-1, Wrap=False)
rad = Radians(Degrees=shift)
rotate = Rotate(Geometry=crv, Angle=rad, Plane=pln)  # -> Geometry, Transform
crv_2 = Curve(rotate.Geometry)
flip = FlipCurve(Curve=crv_2)  # -> Curve, Flag
panel = Panel(lng)
divide = DivideCurve(Curve=crv_2, Count=钢架密度, Kinks=False)  # -> Points, Tangents, Parameters
divide_2 = DivideCurve(Curve=flip.Curve, Count=钢架密度, Kinks=False)  # -> Points, Tangents, Parameters
series = Series(Start=0, Step=1, Count=panel)
flip_2 = FlipMatrix(Data=divide.Points)
graft = GraftTree(Tree=series, IncludeEmptyLists=True, IncludeNullItems=True)
toggle = BooleanToggle(False)
shift_2 = ShiftList(List=divide_2.Points, Shift=graft, Wrap=True)
flip_3 = FlipMatrix(Data=shift_2)
intcrv = Interpolate(Vertices=flip_2, Degree="3", Periodic=toggle, KnotStyle=1)  # -> Curve, Length, Domain
intcrv_2 = Interpolate(Vertices=flip_3, Degree="3", Periodic=toggle, KnotStyle=1)  # -> Curve, Length, Domain
panel_2 = Panel(分段)
offset = Offset(Curve=intcrv.Curve, Distance=Slider(-12, range=-15..0), Plane=PlaneXY(0, 0, 0), Corners=1)
offset_2 = Offset(Curve=intcrv.Curve, Distance=Slider(10, range=0..10), Plane=PlaneXY(0, 0, 0), Corners=1)
pframes_2 = PerpFrames(Curve=intcrv.Curve, Count=panel_2, Align=True)  # -> Frames, Parameters
viewer = ParamViewer(divide.Points)
pframes_3 = PerpFrames(Curve=intcrv_2.Curve, Count=panel_2, Align=True)  # -> Frames, Parameters
rectangle = Rectangle(Plane=pframes_3.Frames, XSize="-0.5 to 0.5", YSize="-0.5 to 0.5", Radius=0)  # -> Rectangle, Length
rectangle_2 = Rectangle(Plane=pframes_2.Frames, XSize="-0.5 to 0.5", YSize="-0.5 to 0.5", Radius=0)  # -> Rectangle, Length
simplify = SimplifyTree(Tree=intcrv.Curve, Front=False)
simplify_2 = SimplifyTree(Tree=intcrv_2.Curve, Front=False)
simplify_3 = SimplifyTree(Tree=rectangle.Rectangle, Front=False)
simplify_4 = SimplifyTree(Tree=rectangle_2.Rectangle, Front=False)

loft = Loft(Curves=simplify_4, Options={Adjust=False, Closed=False, LoftEnds=0, LoftSimp=0, LoftType=0, Rebuild=10, Refit=0.01})
loft_2 = Loft(Curves=simplify_3, Options={Adjust=False, Closed=False, LoftEnds=0, LoftSimp=0, LoftType=0, Rebuild=10, Refit=0.01})
loft_3 = Loft(Curves=rotate.Geometry, Options={Adjust=False, Closed=False, LoftEnds=0, LoftSimp=0, LoftType=0, Rebuild=10, Refit=0.01})
loft_4 = Loft(
    Curves=[offset_2, offset],
    Options={Adjust=False, Closed=False, LoftEnds=0, LoftSimp=0, LoftType=0, Rebuild=10, Refit=0.01})

swp1 = Sweep1(Rail=simplify_2, Sections=simplify_3, Miter=1)  # disabled
swp1_2 = Sweep1(Rail=simplify, Sections=simplify_4, Miter=1)  # disabled
